# Grasshopper definition p205.gh (Grasshopper 1.0.7)
# plug-ins: Kangaroo2 Components

number_slider = Slider(8, range=0..10)
number_slider_2 = Slider(8, range=0..10)
number_slider_3 = Slider(8, range=0..10)
ghpython_script = GhPythonScript(x=number_slider, y=number_slider, z=number_slider)  # -> out, box, a, b
# ---------- ghpython_script: Python ----------
import math
import Rhino.Geometry as rg
import rhinoscriptsyntax as rs
import ghpythonlib.components as gh

class Box:
    def __init__(self, x, y, z):
        self.plane = rg.Plane.WorldXY
        self.x = x
        self.y = y
        self.z = z
        self.box = self.box_gen()
        
    def get_size(self):
        size_dict = {'x':self.x, 'y':self.y, 'z':self.z}
        return size_dict
        
    def box_gen(self):
        size_x = self.get_size()['x']
        size_y = self.get_size()['y']
        size_z = self.get_size()['z']
        box = gh.CenterBox(self.plane, size_x, size_y, size_z)
        return box
        
    def box_array(self):
        size_x = self.get_size()['x']
        size_y = self.get_size()['y']
        size_z = self.get_size()['z']
        array = gh.BoxArray(self.box, self.box, size_x, size_y, size_z)[0]
        return array


if __name__ == "__main__":
    box = Box(x,y,z)
    box = box.box_array()
#    a = box.box_gen()
# ---------- end ghpython_script ----------
center_box = CenterBox(Base=PlaneXY(0, 0, 0), X=number_slider_2, Y=number_slider_2, Z=number_slider_2)
box_array = BoxArray(Geometry=center_box, Cell=center_box, XCount=number_slider_3, YCount=number_slider_3, ZCount=number_slider_3)  # -> Geometry, Transform
solid_union = SolidUnion(Breps=box_array.Geometry)
populate_geometry = PopulateGeometry(Geometry=solid_union, Count=Slider(6, range=0..10), Seed=Slider(35, range=0..100))
sphere = Sphere(Base=populate_geometry, Radius=Slider(43, range=0..100))
brep = Brep(solid_union)
geometry = Geometry(box_array.Geometry)
volume = Volume(Geometry=geometry)  # -> Volume, Centroid
solid_difference = SolidDifference(BrepsA=brep, BrepsB=sphere)
point_in_brep = PointInBrep(Brep=solid_difference, Point=volume.Centroid, Strict=False)
cull_pattern = CullPattern(List=geometry, CullPattern=point_in_brep)
brep_wireframe = BrepWireframe(Brep=cull_pattern, Density=-1)
removeduplicatelines = RemoveDuplicateLines(Lines=flatten(brep_wireframe), Tolerance=0.01)
pipe = Pipe(Curve=removeduplicatelines, Radius=Slider(0.7, range=0..1), Caps=Slider(2, range=0..10))
custom_preview = CustomPreview(Geometry=pipe, Material=ColourSwatch(SwatchColor=RGB(255, 255, 255)))
